# Dynamo graph parametric bridge - 3SPAN - ALL.dyn (Dynamo 2.0.1.5055)

ความส_งสะพาน = DoubleSlider(9000, range=0..9000 step 500)  # graph input

# group: ELEVATION FLOOR
select_model_element = DSModelElementSelection()  # 1 picked in the model; graph input
string = StringInput("Elevation")  # graph input
setParameterByName = Element.SetParameterByName(element=select_model_element, parameterName=string, value=ความส_งสะพาน)

# group: INPUT
ความกว_างถนน = DoubleSlider(15, range=9..15 step 1)  # graph input
ช_วงสะพาน_1 = DoubleSlider(12000, range=5000..12000 step 1000)  # graph input
ช_วงสะพาน_2 = DoubleSlider(12000, range=5000..12000 step 1000)  # graph input
ช_วงสะพาน_3 = DoubleSlider(12000, range=5000..12000 step 1000)  # graph input

ความกว_างสะพาน_ค_า_y_ของเสา = CodeBlock(y=ความกว_างถนน) { y*1000; }
code_block = CodeBlock(y=ความกว_างสะพาน_ค_า_y_ของเสา) { y; }

# group: แถวที่1
select_model_element_2 = DSModelElementSelection()  # 1 picked in the model; graph input
byCoordinates = Point.ByCoordinates()
setLocation = Element.SetLocation(element=select_model_element_2, geometry=byCoordinates)
select_model_element_3 = DSModelElementSelection()  # 1 picked in the model; graph input
byCoordinates_2 = Point.ByCoordinates(y=code_block)
setLocation_2 = Element.SetLocation(element=select_model_element_3, geometry=byCoordinates_2)

ตำแหน_งตอม_อ_ค_า_x_ของเสา = CodeBlock(a=ช_วงสะพาน_1, b=ช_วงสะพาน_2, c=ช_วงสะพาน_3) { xแถวที่1=0; xแถวที่2=a; xแถวที่3=a+b; xแถวที่4=a+b+c; }

# group: แถวที่4
select_model_element_4 = DSModelElementSelection()  # 1 picked in the model; graph input
byCoordinates_3 = Point.ByCoordinates(x=ตำแหน_งตอม_อ_ค_า_x_ของเสา.out3)
setLocation_3 = Element.SetLocation(element=select_model_element_4, geometry=byCoordinates_3)
select_model_element_5 = DSModelElementSelection()  # 1 picked in the model; graph input
byCoordinates_4 = Point.ByCoordinates(x=ตำแหน_งตอม_อ_ค_า_x_ของเสา.out3, y=code_block)
setLocation_4 = Element.SetLocation(element=select_model_element_5, geometry=byCoordinates_4)

# group: แถวที่3
select_model_element_6 = DSModelElementSelection()  # 1 picked in the model; graph input
byCoordinates_5 = Point.ByCoordinates(x=ตำแหน_งตอม_อ_ค_า_x_ของเสา.out2)
setLocation_5 = Element.SetLocation(element=select_model_element_6, geometry=byCoordinates_5)
select_model_element_7 = DSModelElementSelection()  # 1 picked in the model; graph input
byCoordinates_6 = Point.ByCoordinates(x=ตำแหน_งตอม_อ_ค_า_x_ของเสา.out2, y=code_block)
setLocation_6 = Element.SetLocation(element=select_model_element_7, geometry=byCoordinates_6)

# group: แถวที่2
select_model_element_8 = DSModelElementSelection()  # 1 picked in the model; graph input
byCoordinates_7 = Point.ByCoordinates(x=ตำแหน_งตอม_อ_ค_า_x_ของเสา.out1)
setLocation_7 = Element.SetLocation(element=select_model_element_8, geometry=byCoordinates_7)
select_model_element_9 = DSModelElementSelection()  # 1 picked in the model; graph input
byCoordinates_8 = Point.ByCoordinates(x=ตำแหน_งตอม_อ_ค_า_x_ของเสา.out1, y=code_block)
setLocation_8 = Element.SetLocation(element=select_model_element_9, geometry=byCoordinates_8)

# group: เสาใน
structural_column_types = StructuralColumnTypes(index=2)  # graph input
levels = Levels(index=0)  # graph input

ตำแหน_งตอม_อ_ค_า_x_ของเสา_2 = CodeBlock(a=ช_วงสะพาน_1, b=ช_วงสะพาน_2, c=ช_วงสะพาน_3) { xแถวที่1=0; xแถวที่2=a; xแถวที่3=a+b; xแถวที่4=a+b+c; }

# group: PIER DATA
n9 = CodeBlock { [[0],[1],[2],[3],[4],[3,6],[3,6],[2.25,4.5,6.75],[2.25,4.5,6.75],[1.5,3,4.5,6,7.5],[1.5,3,4.5,6,7.5],[11],[1.23,2.5,3.75,5,6.25,7.5]]; }  # "9"
n10 = CodeBlock { [[0],[1],[2],[3],[4],[2.5,5,7.5],[2.5,5,7.5],[2,4,6,8],[2,4,6,8],[1.4,2.8,4.2,5.6,7,8.4],[1.4,2.8,4.2,5.6,7,8.4],[11],[1.1,2.2,3.3,4.4,5.5,6.6,7.7,8.8]]; }  # "10"
n11 = CodeBlock { [[0],[1],[2],[3],[4],[2.75,5.5,8.25],[2.75,5.5,8.25],[1.8,3.65,5.5,7.35,9.2],[1.8,3.65,5.5,7.35,9.2],[1.35,2.75,4.125,5.5,6.875,8.25,9.625],[1.35,2.75,4.125,5.5,6.875,8.25,9.625],[11],[1.2,2.4,3.6,4.8,6,7.2,8.4,9.6]]; }  # "11"
n12 = CodeBlock { [[0],[1],[2],[3],[4],[2.4,4.8,7.2,9.6],[2.4,4.8,7.2,9.6],[2,4,6,8,10],[2,4,6,8,10],[1.5,3,4.5,6,7.5,9,10.5],[1.5,3,4.5,6,7.5,9,10.5],[11],[1.3,2.6,3.9,5.2,6.5,7.8,9.1,10.4]]; }  # "12"
n13 = CodeBlock { [[0],[1],[2],[3],[4],[2.6,5.2,7.8,10.4],[2.6,5.2,7.8,10.4],[1.85,3.7,5.55,7.4,9.25,11.1],[1.85,3.7,5.55,7.4,9.25,11.1],[1.45,2.9,4.35,5.8,7.25,8.7,10.15,11.6],[1.45,2.9,4.35,5.8,7.25,8.7,10.15,11.6],[11],[1.3,2.6,3.9,5.2,6.5,7.8,9.1,10.4,11.7]]; }  # "13"
n14 = CodeBlock { [[0],[1],[2],[3],[4],[2.3,4.6,6.9,9.2,11.5],[2.3,4.6,6.9,9.2,11.5],[2,4,6,8,10,12],[2,4,6,8,10,12],[1.55,3.1,4.65,6.2,7.75,9.3,10.85,12.4],[1.55,3.1,4.65,6.2,7.75,9.3,10.85,12.4],[11],[1.4,2.8,4.2,5.6,7,8.4,9.8,11.2,12.6]]; }  # "14"
n15 = CodeBlock { [[0],[1],[2],[3],[4],[2.5,5,7.5,10,12.5],[2.5,5,7.5,10,12.5],[2.1,4.2,6.3,8.4,10.5,12.6],[2.1,4.2,6.3,8.4,10.5,12.6],[1.5,3,4.5,6,7.5,9,10.5,12,13.5],[1.5,3,4.5,6,7.5,9,10.5,12,13.5],[11],[1.25,2.5,3.75,5,6.25,7.5,8.75,10,11.25,12.5,13.75]]; }  # "15"
data = CodeBlock(a=n9, b=n10, c=n11, d=n12, e=n13, f=n14, g=n15)
# ---------- data.designscript (16 lines) ----------
nine 		= 	a;

ten 		= 	b;

eleven 		= 	c;

twelve 		= 	d;

Thirteen 	= 	e;

fourteen 	= 	f;

fifteen 	= 	g;


[[0],[1],[2],[3],[4],[5],[6],[7],[8],nine,ten,eleven,twelve,Thirteen,fourteen,fifteen];
# ----------------------------------------

code_block_2 = CodeBlock(a=data.out7) { a; }
ค_า_a_roadway_width_m = Watch(ความกว_างถนน)
ค_า_span = CodeBlock(a=ช_วงสะพาน_1, b=ช_วงสะพาน_2, c=ช_วงสะพาน_3, d=ช_วงสะพาน_3) { yแถวที่1=a; yแถวที่2=b; yแถวที่3=c; yแถวที่4=d; }

# group: แถวที่1 (หา span max)
max = Math.Max(value1=ค_า_span.out0, value2=ค_า_span.out0)
watch = Watch(max)
code_block_3 = CodeBlock(a=watch) { a/1000; }

# group: column coordination แถวที่1
a_road_width_b_span = CodeBlock(p=code_block_2, a=ค_า_a_roadway_width_m, b=code_block_3) { p[a][b]; }
watch_2 = Watch(a_road_width_b_span)
แปลงหน_วย_เมตร_ม_ลล_เมตร = CodeBlock(a=watch_2) { a*1000; }
number_slider = DoubleSlider(0, range=0..100 step 0.1)  # graph input
byCoordinates_9 = Point.ByCoordinates(y=แปลงหน_วย_เมตร_ม_ลล_เมตร, z=number_slider)
Y = Point.Y(point=byCoordinates_9)

# group: แถวที่ 1
byCoordinates_10 = Point.ByCoordinates(x=ตำแหน_งตอม_อ_ค_า_x_ของเสา_2.out0, y=Y)
byPointAndLevel = FamilyInstance.ByPointAndLevel(familyType=structural_column_types, point=byCoordinates_10, level=levels)
watch_3 = Watch(byCoordinates_10)

# group: เสาริม
code_block_4 = CodeBlock {  }

# group: เสาใน
code_block_5 = CodeBlock {  }

# group: แถวที่2 (หา span max)
max_2 = Math.Max(value1=ค_า_span.out0, value2=ค_า_span.out1)
watch_4 = Watch(max_2)
code_block_6 = CodeBlock(a=watch_4) { a/1000; }

# group: column coordination แถวที่1
a_road_width_b_span_2 = CodeBlock(p=code_block_2, a=ค_า_a_roadway_width_m, b=code_block_6) { p[a][b]; }
watch_5 = Watch(a_road_width_b_span_2)
แปลงหน_วย_เมตร_ม_ลล_เมตร_2 = CodeBlock(a=watch_5) { a*1000; }
number_slider_2 = DoubleSlider(0, range=0..100 step 0.1)  # graph input
byCoordinates_11 = Point.ByCoordinates(y=แปลงหน_วย_เมตร_ม_ลล_เมตร_2, z=number_slider_2)
Y_2 = Point.Y(point=byCoordinates_11)

# group: แถวที่ 2
byCoordinates_12 = Point.ByCoordinates(x=ตำแหน_งตอม_อ_ค_า_x_ของเสา_2.out1, y=Y_2)
byPointAndLevel_2 = FamilyInstance.ByPointAndLevel(familyType=structural_column_types, point=byCoordinates_12, level=levels)
watch_6 = Watch(byCoordinates_12)

# group: แถวที่3 (หา span max)
max_3 = Math.Max(value1=ค_า_span.out1, value2=ค_า_span.out2)
watch_7 = Watch(max_3)
code_block_7 = CodeBlock(a=watch_7) { a/1000; }

# group: column coordination แถวที่1
a_road_width_b_span_3 = CodeBlock(p=code_block_2, a=ค_า_a_roadway_width_m, b=code_block_7) { p[a][b]; }
watch_8 = Watch(a_road_width_b_span_3)
แปลงหน_วย_เมตร_ม_ลล_เมตร_3 = CodeBlock(a=watch_8) { a*1000; }
number_slider_3 = DoubleSlider(0, range=0..100 step 0.1)  # graph input
byCoordinates_13 = Point.ByCoordinates(y=แปลงหน_วย_เมตร_ม_ลล_เมตร_3, z=number_slider_3)
Y_3 = Point.Y(point=byCoordinates_13)

# group: แถวที่ 3
byCoordinates_14 = Point.ByCoordinates(x=ตำแหน_งตอม_อ_ค_า_x_ของเสา_2.out2, y=Y_3)
byPointAndLevel_3 = FamilyInstance.ByPointAndLevel(familyType=structural_column_types, point=byCoordinates_14, level=levels)
watch_9 = Watch(byCoordinates_14)

# group: แถวที่4 (หา span max)
max_4 = Math.Max(value1=ค_า_span.out3, value2=ค_า_span.out3)
watch_10 = Watch(max_4)
code_block_8 = CodeBlock(a=watch_10) { a/1000; }

# group: column coordination แถวที่1
a_road_width_b_span_4 = CodeBlock(p=code_block_2, a=ค_า_a_roadway_width_m, b=code_block_8) { p[a][b]; }
watch_11 = Watch(a_road_width_b_span_4)
แปลงหน_วย_เมตร_ม_ลล_เมตร_4 = CodeBlock(a=watch_11) { a*1000; }
number_slider_4 = DoubleSlider(0, range=0..100 step 0.1)  # graph input
byCoordinates_15 = Point.ByCoordinates(y=แปลงหน_วย_เมตร_ม_ลล_เมตร_4, z=number_slider_4)
Y_4 = Point.Y(point=byCoordinates_15)

# group: แถวที่ 4
byCoordinates_16 = Point.ByCoordinates(x=ตำแหน_งตอม_อ_ค_า_x_ของเสา_2.out3, y=Y_4)
watch_12 = Watch(byCoordinates_16)
byPointAndLevel_4 = FamilyInstance.ByPointAndLevel(familyType=structural_column_types, point=byCoordinates_16, level=levels)

ทางเด_นเท_า = DoubleSlider(-1000, range=-1000..-500 step 500)  # graph input
ความกว_าง_wingwall = CodeBlock(a=ค_า_a_roadway_width_m, b=ทางเด_นเท_า) { (a*1000)+2*(-b); }

# group: WING WALL
select_model_elements = DSModelElementsSelection()  # 2 picked in the model; graph input
string_2 = StringInput("Road Width")  # graph input
setParameterByName_2 = Element.SetParameterByName(element=select_model_elements, parameterName=string_2, value=ความกว_าง_wingwall)

# group: width footing DATA
width_footing = CodeBlock { [[0],[1],[2],[3],[4],[2100],[2100],[2300],[2300],[2750],[2750],[11],[3000]]; }

ค_า_span_2 = CodeBlock(a=code_block_3, b=code_block_6, c=code_block_7, d=code_block_8) { yแถวที่1=a; yแถวที่2=b; yแถวที่3=c; yแถวที่4=d; }

# group: แถวที่ 1
select_model_element_10 = DSModelElementSelection()  # 1 picked in the model; graph input
string_3 = StringInput("footing width")  # graph input
b_span = CodeBlock(p=width_footing, b=ค_า_span_2.out0) { p[b]; }
watch_13 = Watch(b_span)
setParameterByName_3 = Element.SetParameterByName(element=select_model_element_10, parameterName=string_3, value=watch_13)

# group: แถวที่22
select_model_element_11 = DSModelElementSelection()  # 1 picked in the model; graph input
string_4 = StringInput("footing width")  # graph input
b_span_2 = CodeBlock(p=width_footing, b=ค_า_span_2.out1) { p[b]; }
watch_14 = Watch(b_span_2)
setParameterByName_4 = Element.SetParameterByName(element=select_model_element_11, parameterName=string_4, value=watch_14)

# group: แถวที่ 4
select_model_element_12 = DSModelElementSelection()  # 1 picked in the model; graph input
string_5 = StringInput("footing width")  # graph input
b_span_3 = CodeBlock(p=width_footing, b=ค_า_span_2.out3) { p[b]; }
watch_15 = Watch(b_span_3)
setParameterByName_5 = Element.SetParameterByName(element=select_model_element_12, parameterName=string_5, value=watch_15)

# group: แถวที่ 3
select_model_element_13 = DSModelElementSelection()  # 1 picked in the model; graph input
string_6 = StringInput("footing width")  # graph input
b_span_4 = CodeBlock(p=width_footing, b=ค_า_span_2.out2) { p[b]; }
watch_16 = Watch(b_span_4)
setParameterByName_6 = Element.SetParameterByName(element=select_model_element_13, parameterName=string_6, value=watch_16)

# group: FOOTNIG
code_block_9 = CodeBlock {  }

code_block_10 = CodeBlock(a=ตำแหน_งตอม_อ_ค_า_x_ของเสา_2.out3) { a-70; }
code_block_11 = CodeBlock(a=ค_า_a_roadway_width_m) { a*1000/2; }

# group: ตำแหน่ง wingwall
select_model_element_14 = DSModelElementSelection()  # 1 picked in the model; graph input
byCoordinates_17 = Point.ByCoordinates(x=code_block_10, y=code_block_11)
setLocation_9 = Element.SetLocation(element=select_model_element_14, geometry=byCoordinates_17)

# group: CAPBEAM
code_block_12 = CodeBlock {  }

บวกค_า_offset_เสา = CodeBlock(a=ทางเด_นเท_า) { a-200; }

# group: PIER
CAPBEAM = DSModelElementsSelection()  # 2 picked in the model; graph input
string_7 = StringInput("Start Join Cutback")  # graph input
watch_17 = Watch(บวกค_า_offset_เสา)
setParameterByName_7 = Element.SetParameterByName(element=CAPBEAM, parameterName=string_7, value=watch_17)
string_8 = StringInput("End Join Cutback")  # graph input
setParameterByName_8 = Element.SetParameterByName(element=CAPBEAM, parameterName=string_8, value=watch_17)

# group: ABUTMENT
CAPBEAM_2 = DSModelElementsSelection()  # 2 picked in the model; graph input
string_9 = StringInput("Start Join Cutback")  # graph input
watch_18 = Watch(บวกค_า_offset_เสา)
setParameterByName_9 = Element.SetParameterByName(element=CAPBEAM_2, parameterName=string_9, value=watch_18)
string_10 = StringInput("End Join Cutback")  # graph input
setParameterByName_10 = Element.SetParameterByName(element=CAPBEAM_2, parameterName=string_10, value=watch_18)

# group: Walk way+Barrier
select_model_element_15 = DSModelElementSelection()  # 1 picked in the model; graph input
string_11 = StringInput("z Offset Value")  # graph input
slab_thickness = CodeBlock { [[0],[1],[2],[3],[4],[320],[360],[390],[430],[470],[530],[600],[600]]; }
create = List.Create(item0=ช_วงสะพาน_1, item1=ช_วงสะพาน_2, item2=ช_วงสะพาน_3)
maximumItem = List.MaximumItem(list=create)
code_block_13 = CodeBlock(a=maximumItem) { a/1000; }
b_span_5 = CodeBlock(p=slab_thickness, b=code_block_13) { p[b]; }
watch_19 = Watch(b_span_5)
code_block_14 = CodeBlock(a=watch_19) { a+10; }
z_offset_value = Element.SetParameterByName(element=select_model_element_15, parameterName=string_11, value=code_block_14)
string_12 = StringInput("y Offset Value")  # graph input
watch_20 = Watch(ทางเด_นเท_า)
y_offset_value = Element.SetParameterByName(element=select_model_element_15, parameterName=string_12, value=watch_20)
string_13 = StringInput("P ( 0.5 หรือ 1.0 )")  # graph input
code_block_15 = CodeBlock(a=ทางเด_นเท_า) { a<-500; }
code_block_16 = CodeBlock { 1000; }
code_block_17 = CodeBlock { 500; }
if_ = If(test=code_block_15, true=code_block_16, false=code_block_17)
watch_21 = Watch(if_)
p_0_5_หร_อ_1_0 = Element.SetParameterByName(element=select_model_element_15, parameterName=string_13, value=watch_21)
string_14 = StringInput("ความกว้างถนน")  # graph input
code_block_18 = CodeBlock(a=ความกว_างสะพาน_ค_า_y_ของเสา, b=watch_21) { a+(2*b); }
watch_22 = Watch(code_block_18)
ความกว_างถนน_2 = Element.SetParameterByName(element=select_model_element_15, parameterName=string_14, value=watch_22)

# group: SLAB
select_model_elements_2 = DSModelElementsSelection()  # 3 picked in the model; graph input
walkway_offset = StringInput("sidewalk offset")  # graph input
code_block_19 = CodeBlock(a=ทางเด_นเท_า) { a<-500; }
code_block_20 = CodeBlock { 1000; }
code_block_21 = CodeBlock { 500; }
if_2 = If(test=code_block_19, true=code_block_20, false=code_block_21)
watch_23 = Watch(if_2)
setParameterByName_11 = Element.SetParameterByName(element=select_model_elements_2, parameterName=walkway_offset, value=watch_23)
ความกว_างถนน_3 = StringInput("width")  # graph input
ความกว_างถนน_4 = CodeBlock(a=ความกว_างสะพาน_ค_า_y_ของเสา) { a; }
watch_24 = Watch(ความกว_างถนน_4)
setParameterByName_12 = Element.SetParameterByName(element=select_model_elements_2, parameterName=ความกว_างถนน_3, value=watch_24)
code_block_22 = CodeBlock { 5000; }
ตำแหน_งพ_น = StringInput("y Offset Value")  # graph input
code_block_23 = CodeBlock(a=watch_24) { a/2; }
setParameterByName_13 = Element.SetParameterByName(element=select_model_elements_2, parameterName=ตำแหน_งพ_น, value=code_block_23)

slab_thickness_2 = CodeBlock { [[0],[1],[2],[3],[4],[320],[360],[390],[430],[470],[530],[600],[600]]; }
ค_า_span_3 = CodeBlock(a=ช_วงสะพาน_1, b=ช_วงสะพาน_2, c=ช_วงสะพาน_3) { span1=a; span2=b; span3=c; }
span_1 = CodeBlock(a=ค_า_span_3.span1) { a/1000; }
span_2 = CodeBlock(a=ค_า_span_3.span2) { a/1000; }
span_3 = CodeBlock(a=ค_า_span_3.span3) { a/1000; }

# group: SLAB
slab_span_1 = DSModelElementSelection()  # 1 picked in the model; graph input
ความหนาพ_น = StringInput("thickness")  # graph input
b_span_6 = CodeBlock(p=slab_thickness_2, b=span_1) { p[b]; }
setParameterByName_14 = Element.SetParameterByName(element=slab_span_1, parameterName=ความหนาพ_น, value=b_span_6)
z_offset = StringInput("z Offset Value")  # graph input
b_span_7 = CodeBlock(p=slab_thickness_2, b=span_2) { p[b]; }
b_span_8 = CodeBlock(p=slab_thickness_2, b=span_3) { p[b]; }
slab_span_2 = DSModelElementSelection()  # 1 picked in the model; graph input
ความหนาพ_น_2 = StringInput("thickness")  # graph input
setParameterByName_15 = Element.SetParameterByName(element=slab_span_2, parameterName=ความหนาพ_น_2, value=b_span_7)
z_offset_2 = StringInput("z Offset Value")  # graph input
slab_span_3 = DSModelElementSelection()  # 1 picked in the model; graph input
ความหนาพ_น_3 = StringInput("thickness")  # graph input
setParameterByName_16 = Element.SetParameterByName(element=slab_span_3, parameterName=ความหนาพ_น_3, value=b_span_8)
z_offset_3 = StringInput("z Offset Value")  # graph input

ค_า_span_4 = CodeBlock(a=b_span_6, b=b_span_7, c=b_span_8) { span1=a; span2=b; span3=c; }
max_5 = Math.Max(int1=ค_า_span_4.span1, int2=ค_า_span_4.span2)
max_6 = Math.Max(int1=ค_า_span_4.span3, int2=max_5)
watch_25 = Watch(max_6)

# group (continued): SLAB
code_block_24 = CodeBlock(a=watch_25, b=b_span_6) { a-b+10; }
setParameterByName_17 = Element.SetParameterByName(element=slab_span_1, parameterName=z_offset, value=code_block_24)
code_block_25 = CodeBlock(a=watch_25, b=b_span_7) { a-b+10; }
setParameterByName_18 = Element.SetParameterByName(element=slab_span_2, parameterName=z_offset_2, value=code_block_25)
code_block_26 = CodeBlock(a=watch_25, b=b_span_8) { a-b+10; }
setParameterByName_19 = Element.SetParameterByName(element=slab_span_3, parameterName=z_offset_3, value=code_block_26)

code_block_27 = CodeBlock { Freeze; }  # unwired: Freeze
ระยะ_rebar_f103_pier = CodeBlock { [[0],[1],[2],[3],[4],[0.25],[0.25],[0.20],[0.20],[0.20],[0.125],[11],[0.125]]; }
max_7 = Math.Max(int1=ช_วงสะพาน_1, int2=ช_วงสะพาน_2)
code_block_28 = CodeBlock(a=max_7) { a/1000; }
b_span_9 = CodeBlock(p=ระยะ_rebar_f103_pier, b=code_block_28) { p[b]; }
watch_26 = Watch(b_span_9)
watch_27 = Watch(max_7)
max_8 = Math.Max(int1=ช_วงสะพาน_3, int2=ช_วงสะพาน_2)
code_block_29 = CodeBlock(a=max_8) { a/1000; }
b_span_10 = CodeBlock(p=ระยะ_rebar_f103_pier, b=code_block_29) { p[b]; }

# group: REBAR PIER
pier_1 = DSModelElementSelection()  # 1 picked in the model; graph input
ตำแหน_งพ_น_2 = StringInput("Spacing")  # graph input
code_block_30 = CodeBlock(a=b_span_9) { a/304.8; }
setParameterByName_20 = Element.SetParameterByName(element=pier_1, parameterName=ตำแหน_งพ_น_2, value=code_block_30)
pier_2 = DSModelElementSelection()  # 1 picked in the model; graph input
ตำแหน_งพ_น_3 = StringInput("Spacing")  # graph input
code_block_31 = CodeBlock(a=b_span_10) { a/304.8; }
setParameterByName_21 = Element.SetParameterByName(element=pier_2, parameterName=ตำแหน_งพ_น_3, value=code_block_31)

ระยะ_rebar_f203_abutment = CodeBlock { [[0],[1],[2],[3],[4],[0.25],[0.25],[0.20],[0.20],[0.125],[0.125],[11],[0.125]]; }
code_block_32 = CodeBlock(a=ช_วงสะพาน_1) { a/1000; }
b_span_11 = CodeBlock(p=ระยะ_rebar_f203_abutment, b=code_block_32) { p[b]; }
code_block_33 = CodeBlock(a=ช_วงสะพาน_3) { a/1000; }
b_span_12 = CodeBlock(p=ระยะ_rebar_f203_abutment, b=code_block_33) { p[b]; }

# group: REBAR ABUTMENT
abutment_1 = DSModelElementSelection()  # 1 picked in the model; graph input
ตำแหน_งพ_น_4 = StringInput("Spacing")  # graph input
code_block_34 = CodeBlock(a=b_span_11) { a/304.8; }
setParameterByName_22 = Element.SetParameterByName(element=abutment_1, parameterName=ตำแหน_งพ_น_4, value=code_block_34)
abutment_2 = DSModelElementSelection()  # 1 picked in the model; graph input
ตำแหน_งพ_น_5 = StringInput("Spacing")  # graph input
code_block_35 = CodeBlock(a=b_span_12) { a/304.8; }
setParameterByName_23 = Element.SetParameterByName(element=abutment_2, parameterName=ตำแหน_งพ_น_5, value=code_block_35)

ระยะ_rebar_s101_slab = CodeBlock { [[0],[1],[2],[3],[4],[0.14],[0.14],[0.125],[0.12],[0.11],[0.10],[11],[0.08]]; }
code_block_36 = CodeBlock(a=ช_วงสะพาน_1) { a/1000; }
b_span_13 = CodeBlock(p=ระยะ_rebar_s101_slab, b=code_block_36) { p[b]; }
ระยะ_rebar_sw101_slab = CodeBlock { [[0],[1],[2],[3],[4],[0.14],[0.14],[0.125],[0.12],[0.11],[0.10],[11],[0.08]]; }
b_span_14 = CodeBlock(p=ระยะ_rebar_sw101_slab, b=code_block_36) { p[b]; }
ระยะ_rebar_t101_slab = CodeBlock { [[0],[1],[2],[3],[4],[0.275],[0.275],[0.25],[0.25],[0.25],[0.20],[11],[0.20]]; }
b_span_15 = CodeBlock(p=ระยะ_rebar_t101_slab, b=code_block_36) { p[b]; }

# group: REBAR SLAB 1
slab_1 = DSModelElementSelection()  # 1 picked in the model; graph input
ตำแหน_งพ_น_6 = StringInput("Spacing")  # graph input
code_block_37 = CodeBlock(a=b_span_13) { a/304.8; }
setParameterByName_24 = Element.SetParameterByName(element=slab_1, parameterName=ตำแหน_งพ_น_6, value=code_block_37)
slab_1_2 = DSModelElementSelection()  # 1 picked in the model; graph input
ตำแหน_งพ_น_7 = StringInput("Spacing")  # graph input
code_block_38 = CodeBlock(a=b_span_14) { a/304.8; }
setParameterByName_25 = Element.SetParameterByName(element=slab_1_2, parameterName=ตำแหน_งพ_น_7, value=code_block_38)
slab_1_3 = DSModelElementSelection()  # 1 picked in the model; graph input
ตำแหน_งพ_น_8 = StringInput("Spacing")  # graph input
code_block_39 = CodeBlock(a=b_span_15) { a/304.8; }
setParameterByName_26 = Element.SetParameterByName(element=slab_1_3, parameterName=ตำแหน_งพ_น_8, value=code_block_39)

code_block_40 = CodeBlock(a=ช_วงสะพาน_2) { a/1000; }
b_span_16 = CodeBlock(p=ระยะ_rebar_s101_slab, b=code_block_40) { p[b]; }
b_span_17 = CodeBlock(p=ระยะ_rebar_sw101_slab, b=code_block_40) { p[b]; }
b_span_18 = CodeBlock(p=ระยะ_rebar_t101_slab, b=code_block_40) { p[b]; }

# group: REBAR SLAB 2
slab_1_4 = DSModelElementSelection()  # 1 picked in the model; graph input
ตำแหน_งพ_น_9 = StringInput("Spacing")  # graph input
code_block_41 = CodeBlock(a=b_span_16) { a/304.8; }
setParameterByName_27 = Element.SetParameterByName(element=slab_1_4, parameterName=ตำแหน_งพ_น_9, value=code_block_41)
slab_1_5 = DSModelElementSelection()  # 1 picked in the model; graph input
ตำแหน_งพ_น_10 = StringInput("Spacing")  # graph input
code_block_42 = CodeBlock(a=b_span_17) { a/304.8; }
setParameterByName_28 = Element.SetParameterByName(element=slab_1_5, parameterName=ตำแหน_งพ_น_10, value=code_block_42)
slab_1_6 = DSModelElementSelection()  # 1 picked in the model; graph input
ตำแหน_งพ_น_11 = StringInput("Spacing")  # graph input
code_block_43 = CodeBlock(a=b_span_18) { a/304.8; }
setParameterByName_29 = Element.SetParameterByName(element=slab_1_6, parameterName=ตำแหน_งพ_น_11, value=code_block_43)

code_block_44 = CodeBlock(a=ช_วงสะพาน_3) { a/1000; }
b_span_19 = CodeBlock(p=ระยะ_rebar_s101_slab, b=code_block_44) { p[b]; }
b_span_20 = CodeBlock(p=ระยะ_rebar_sw101_slab, b=code_block_44) { p[b]; }
b_span_21 = CodeBlock(p=ระยะ_rebar_t101_slab, b=code_block_44) { p[b]; }

# group: REBAR SLAB 3
slab_1_7 = DSModelElementSelection()  # 1 picked in the model; graph input
ตำแหน_งพ_น_12 = StringInput("Spacing")  # graph input
code_block_45 = CodeBlock(a=b_span_19) { a/304.8; }
setParameterByName_30 = Element.SetParameterByName(element=slab_1_7, parameterName=ตำแหน_งพ_น_12, value=code_block_45)
slab_1_8 = DSModelElementSelection()  # 1 picked in the model; graph input
ตำแหน_งพ_น_13 = StringInput("Spacing")  # graph input
code_block_46 = CodeBlock(a=b_span_20) { a/304.8; }
setParameterByName_31 = Element.SetParameterByName(element=slab_1_8, parameterName=ตำแหน_งพ_น_13, value=code_block_46)
slab_1_9 = DSModelElementSelection()  # 1 picked in the model; graph input
ตำแหน_งพ_น_14 = StringInput("Spacing")  # graph input
code_block_47 = CodeBlock(a=b_span_21) { a/304.8; }
setParameterByName_32 = Element.SetParameterByName(element=slab_1_9, parameterName=ตำแหน_งพ_น_14, value=code_block_47)
